# Dynamo graph Ejercicio limpieza_prefijos.dyn (Dynamo 2.16.2.5624)

# group: LIMPIEZA DE PLANTILLAS
boolean = BoolSelector(false)
python_script = Python(IN[0]=boolean)  # CPython3
# ---------- python_script.python (49 lines) ----------
import clr
import sys
sys.path.append('C:\Program Files (x86)\IronPython 2.7\Lib')
import System
from System import Array
from System.Collections.Generic import *
clr.AddReference('ProtoGeometry')
from Autodesk.DesignScript.Geometry import *
clr.AddReference("RevitNodes")
import Revit
clr.ImportExtensions(Revit.Elements)
clr.ImportExtensions(Revit.GeometryConversion)
clr.AddReference("RevitServices")
import RevitServices
from RevitServices.Persistence import DocumentManager 
from RevitServices.Transactions import TransactionManager 

clr.AddReference("RevitAPI")
clr.AddReference("RevitAPIUI")

import Autodesk 
from Autodesk.Revit.DB import *
from Autodesk.Revit.UI import *

doc = DocumentManager.Instance.CurrentDBDocument
uiapp = DocumentManager.Instance.CurrentUIApplication 
app = uiapp.Application 
uidoc = uiapp.ActiveUIDocument

#######OK NOW YOU CAN CODE########

inicio=UnwrapElement(IN[0])

if inicio: 
    vistas=FilteredElementCollector(doc).OfClass(View).ToElements() 
    plantillas_usadas=set([x.ViewTemplateId for x in vistas  if str(x.ViewTemplateId)!='-1'])
    total_plantillas=set([(x.Id) for x in vistas if x.IsTemplate])
    plantillas_no_usadas=total_plantillas.difference(plantillas_usadas)
    
    TransactionManager.Instance.EnsureInTransaction(doc)
    [doc.Delete(x) for x in plantillas_no_usadas]
    
    TransactionManager.Instance.TransactionTaskDone()
    m_salida="Limpieza ejecutada" 
else: 
    m_salida= "Active 'True' para comenzar la limpieza" 

# Assign your output to the OUT variable.
OUT = m_salida
# ----------------------------------------

# group: LIMPIEZA DE PLANTILLAS 2.0
boolean_2 = BoolSelector(false)
python_script_2 = Python(IN[0]=boolean_2)  # CPython3
# ---------- python_script_2.python (64 lines) ----------
import clr
import sys
sys.path.append('C:\Program Files (x86)\IronPython 2.7\Lib')
import System
from System import Array
from System.Collections.Generic import *
clr.AddReference('ProtoGeometry')
from Autodesk.DesignScript.Geometry import *
clr.AddReference("RevitNodes")
import Revit
clr.ImportExtensions(Revit.Elements)
clr.ImportExtensions(Revit.GeometryConversion)
clr.AddReference("RevitServices")
import RevitServices
from RevitServices.Persistence import DocumentManager 
from RevitServices.Transactions import TransactionManager 

clr.AddReference("RevitAPI")
clr.AddReference("RevitAPIUI")

import Autodesk 
from Autodesk.Revit.DB import *
from Autodesk.Revit.UI import *

doc = DocumentManager.Instance.CurrentDBDocument
uiapp = DocumentManager.Instance.CurrentUIApplication 
app = uiapp.Application 
uidoc = uiapp.ActiveUIDocument

#######OK NOW YOU CAN CODE########

inicio=UnwrapElement(IN[0])

def limpieza_plantillas_vista(doc, bool=False):
    exito=0
    
    if inicio: 
        vistas=FilteredElementCollector(doc).OfClass(View).ToElements() 
        
        total_plantillas, plantillas_usadas=set(), set() 
        for v in vistas: 
            if v.IsTemplate: 
                total_plantillas.add(v.Id) 
            else: 
                if v.ViewTemplateId.IntegerValue!=-1: 
                    plantillas_usadas.add(v.ViewTemplateId)
        plantillas_sin_uso=total_plantillas.difference(plantillas_usadas) 
        if plantillas_sin_uso: 
            for p in plantillas_sin_uso: 
                TransactionManager.Instance.EnsureInTransaction(doc)
                doc.Delete(p)
                exito+=1
                
                TransactionManager.Instance.TransactionTaskDone()
                m_salida="Limpieza ejecutada. Se han eliminado {0} plantillas de un total de {1}".format(exito, len(total_plantillas))
        else: 
            m_salida="No existen plantillas sin uso"      
      
    else: 
        m_salida= "Active 'True' para comenzar la limpieza" 
    return m_salida

# Assign your output to the OUT variable.
OUT = limpieza_plantillas_vista(doc, inicio)
# ----------------------------------------

# group: LIMPIEZA DE FILTROS
boolean_3 = BoolSelector(false)
python_script_3 = Python(IN[0]=boolean_3)  # CPython3
# ---------- python_script_3.python (67 lines) ----------
import clr
import sys
sys.path.append('C:\Program Files (x86)\IronPython 2.7\Lib')
import System
from System import Array
from System.Collections.Generic import *
clr.AddReference('ProtoGeometry')
from Autodesk.DesignScript.Geometry import *
clr.AddReference("RevitNodes")
import Revit
clr.ImportExtensions(Revit.Elements)
clr.ImportExtensions(Revit.GeometryConversion)
clr.AddReference("RevitServices")
import RevitServices
from RevitServices.Persistence import DocumentManager 
from RevitServices.Transactions import TransactionManager 

clr.AddReference("RevitAPI")
clr.AddReference("RevitAPIUI")

import Autodesk 
from Autodesk.Revit.DB import *
from Autodesk.Revit.UI import *

doc = DocumentManager.Instance.CurrentDBDocument
uiapp = DocumentManager.Instance.CurrentUIApplication 
app = uiapp.Application 
uidoc = uiapp.ActiveUIDocument

#######OK NOW YOU CAN CODE########

inicio=UnwrapElement(IN[0])

def limpieza_filtros_vista(doc, bool=False):
    exito=0
    
    if inicio: 
        vistas=FilteredElementCollector(doc).OfClass(View).ToElements() 
        total_filtros=set([x.Id for x in FilteredElementCollector(doc).OfClass(ParameterFilterElement).ToElements()])
        
        filtros_usados=set()
        for v in vistas: 
            try: 
                filtros=v.GetFilters()
                for f in filtros: 
                    filtros_usados.add(f) 
            except: 
                pass
        filtros_sin_uso=total_filtros.difference(filtros_usados) 
        
        if filtros_sin_uso: 
            for f in filtros_sin_uso: 
                TransactionManager.Instance.EnsureInTransaction(doc)
                doc.Delete(f)
                exito+=1
                
                TransactionManager.Instance.TransactionTaskDone()
                m_salida="Limpieza ejecutada. Se han eliminado {0} filtros de un total de {1}".format(exito, len(total_filtros))
        else: 
            m_salida="No existen filtros sin uso"      
    
    else: 
        m_salida= "Active 'True' para comenzar la limpieza" 
    return m_salida

# Assign your output to the OUT variable.
OUT = limpieza_filtros_vista(doc, inicio)
# ----------------------------------------

# group: LIMPIEZA DE VISTAS
boolean_4 = BoolSelector(false)
python_script_4 = Python(IN[0]=boolean_4)  # CPython3
# ---------- python_script_4.python (82 lines) ----------
import clr
import sys
sys.path.append('C:\Program Files (x86)\IronPython 2.7\Lib')
import System
from System import Array
from System.Collections.Generic import *
clr.AddReference('ProtoGeometry')
from Autodesk.DesignScript.Geometry import *
clr.AddReference("RevitNodes")
import Revit
clr.ImportExtensions(Revit.Elements)
clr.ImportExtensions(Revit.GeometryConversion)
clr.AddReference("RevitServices")
import RevitServices
from RevitServices.Persistence import DocumentManager 
from RevitServices.Transactions import TransactionManager 

clr.AddReference("RevitAPI")
clr.AddReference("RevitAPIUI")

import Autodesk 
from Autodesk.Revit.DB import *
from Autodesk.Revit.UI import *

doc = DocumentManager.Instance.CurrentDBDocument
uiapp = DocumentManager.Instance.CurrentUIApplication 
app = uiapp.Application 
uidoc = uiapp.ActiveUIDocument

#######OK NOW YOU CAN CODE########

inicio=UnwrapElement(IN[0])

def limpieza_vistas(doc, bool=False):
    exito=0
    
    if inicio: 
        planos=FilteredElementCollector(doc).OfClass(ViewSheet).ToElements() 
        vistas_uso=set()

        
        for plano in planos: 
            ids_vistas_plano=plano.GetAllPlacedViews()
            for id in ids_vistas_plano: 
                vistas_uso.add(id)
                vista=doc.GetElement(id)
                dependencia=vista.GetPrimaryViewId()
                if dependencia.IntegerValue!=-1: 
                    vistas_uso.add(dependencia)
                
                param=BuiltInParameter.SECTION_PARENT_VIEW_NAME
                
                if vista.get_Parameter(param): 
                    pariente=vista.get_Parameter(param).AsElementId()
                    if pariente.IntegerValue!=-1:
                        vistas_uso.add(pariente)                     
                        
                
                
                
        total_vistas=set([x.Id for x in FilteredElementCollector(doc).OfCategory(BuiltInCategory.OST_Views).ToElements() if not x.IsTemplate])
                
                
        vistas_sin_uso=total_vistas.difference(vistas_uso) 
        
        if vistas_sin_uso: 
            for v in vistas_sin_uso: 
                TransactionManager.Instance.EnsureInTransaction(doc)
                doc.Delete(v)
                exito+=1
                
                TransactionManager.Instance.TransactionTaskDone()
                m_salida="Limpieza ejecutada. Se han eliminado {0} vistass de un total de {1}".format(exito, len(total_vistas))
        else: 
            m_salida="No existen filtros sin uso"      
    
    else: 
        m_salida= "Active 'True' para comenzar la limpieza" 
    return m_salida

# Assign your output to the OUT variable.
OUT = limpieza_vistas(doc, inicio)
# ----------------------------------------

# group: LIMPIEZA DE VISTAS CON/SIN PREFIJO
boolean_5 = BoolSelector(false)
prefijo = StringInput("COORD")
sufijo = StringInput("KEEP")
python_script_5 = Python(IN[0]=boolean_5, IN[1]=prefijo, IN[2]=sufijo)  # CPython3
# ---------- python_script_5.python (94 lines) ----------
import clr
import sys
sys.path.append('C:\Program Files (x86)\IronPython 2.7\Lib')
import System
from System import Array
from System.Collections.Generic import *
clr.AddReference('ProtoGeometry')
from Autodesk.DesignScript.Geometry import *
clr.AddReference("RevitNodes")
import Revit
clr.ImportExtensions(Revit.Elements)
clr.ImportExtensions(Revit.GeometryConversion)
clr.AddReference("RevitServices")
import RevitServices
from RevitServices.Persistence import DocumentManager 
from RevitServices.Transactions import TransactionManager 

clr.AddReference("RevitAPI")
clr.AddReference("RevitAPIUI")

import Autodesk 
from Autodesk.Revit.DB import *
from Autodesk.Revit.UI import *

doc = DocumentManager.Instance.CurrentDBDocument
uiapp = DocumentManager.Instance.CurrentUIApplication 
app = uiapp.Application 
uidoc = uiapp.ActiveUIDocument

#######OK NOW YOU CAN CODE########

inicio=UnwrapElement(IN[0])
prefijo=UnwrapElement(IN[1]) 
sufijo=UnwrapElement(IN[2])

def limpieza_vistas(doc, bool=False):
    exito=0
    
    if inicio: 
        planos=FilteredElementCollector(doc).OfClass(ViewSheet).ToElements() 
        vistas_uso=set()

        
        for plano in planos: 
            ids_vistas_plano=plano.GetAllPlacedViews()
            for id in ids_vistas_plano: 
                vistas_uso.add(id)
                vista=doc.GetElement(id)
                dependencia=vista.GetPrimaryViewId()
                if dependencia.IntegerValue!=-1: 
                    vistas_uso.add(dependencia)
                
                param=BuiltInParameter.SECTION_PARENT_VIEW_NAME
                
                if vista.get_Parameter(param): 
                    pariente=vista.get_Parameter(param).AsElementId()
                    if pariente.IntegerValue!=-1:
                        vistas_uso.add(pariente)                     
                        
                
                
                
        total_vistas=set([x.Id for x in FilteredElementCollector(doc).OfCategory(BuiltInCategory.OST_Views).ToElements() if not x.IsTemplate])
        
        if len(prefijo)!=0 or len(sufijo)!=0: 
            vistas_conservar=set() 
            test=1
            for id in total_vistas: 
                vista=doc.GetElement(id)
                if vista.Name.startswith(prefijo) or vista.Name.endswith(sufijo): 
                    vistas_conservar.add(vista.Id) 

                
        vistas_no_descartadas=total_vistas.difference(vistas_conservar)        
        vistas_sin_uso=vistas_no_descartadas.difference(vistas_uso) 
        
        if vistas_sin_uso: 
            for v in vistas_sin_uso: 
                TransactionManager.Instance.EnsureInTransaction(doc)
                doc.Delete(v)
                exito+=1
                
                TransactionManager.Instance.TransactionTaskDone()
                m_salida="Limpieza ejecutada. Se han eliminado {0} vistass de un total de {1}".format(exito, len(total_vistas))
        else: 
            m_salida="No existen vistas sin uso"      
    
    else: 
        m_salida= "Active 'True' para comenzar la limpieza" 
    return m_salida

# Assign your output to the OUT variable.
#OUT = limpieza_vistas(doc, inicio)
OUT=limpieza_vistas(doc, inicio)
# ----------------------------------------

# group: LIMPIEZA DE TABLAS
boolean_6 = BoolSelector(true)
python_script_6 = Python(IN[0]=boolean_6)  # CPython3
# ---------- python_script_6.python (62 lines) ----------
import clr
import sys
sys.path.append('C:\Program Files (x86)\IronPython 2.7\Lib')
import System
from System import Array
from System.Collections.Generic import *
clr.AddReference('ProtoGeometry')
from Autodesk.DesignScript.Geometry import *
clr.AddReference("RevitNodes")
import Revit
clr.ImportExtensions(Revit.Elements)
clr.ImportExtensions(Revit.GeometryConversion)
clr.AddReference("RevitServices")
import RevitServices
from RevitServices.Persistence import DocumentManager 
from RevitServices.Transactions import TransactionManager 

clr.AddReference("RevitAPI")
clr.AddReference("RevitAPIUI")

import Autodesk 
from Autodesk.Revit.DB import *
from Autodesk.Revit.UI import *

doc = DocumentManager.Instance.CurrentDBDocument
uiapp = DocumentManager.Instance.CurrentUIApplication 
app = uiapp.Application 
uidoc = uiapp.ActiveUIDocument

#######OK NOW YOU CAN CODE########

inicio=UnwrapElement(IN[0])

def limpieza_tablas(doc, bool=False):
    exito=0
    
    if inicio: 
        tablas_uso_lista=[x.Id for x in FilteredElementCollector(doc).OfClass(ScheduleSheetInstance).ToElements()]
        tablas_uso=set(tablas_uso_lista)
        
        tablas=set([x.Id for x in FilteredElementCollector(doc).OfClass(ViewSchedule).ToElements()]) 
        
        tablas_sin_uso=tablas.difference(tablas_uso) 
               
        
        if tablas_sin_uso: 
            for id in tablas_sin_uso: 
                TransactionManager.Instance.EnsureInTransaction(doc)
                doc.Delete(id)
                exito+=1
                
                TransactionManager.Instance.TransactionTaskDone()
                m_salida="Limpieza ejecutada. Se han eliminado {0} vistass de un total de {1}".format(exito, len(tablas))
        else: 
            m_salida="No existen filtros sin uso"      
    
    else: 
        m_salida= "Active 'True' para comenzar la limpieza" 
    return m_salida

# Assign your output to the OUT variable.
OUT = limpieza_tablas(doc, inicio)
# ----------------------------------------
